# Dynamo graph 2020-08-03 Dynamo Car Wheelbase Generator.dyn (Dynamo 2.5.3.7984)

# group: Input Data
front_tyre_size = StringInput("265/30 R19")
front_track_width_in_mm = DoubleInput(1727)
ground_clearance_in_mm = DoubleSlider(110, range=50..300 step 0.1)
wheelbase_length_in_mm = DoubleInput(2650)
rear_tyre_size = StringInput("345/30 R20")
rear_track_width_in_mm = DoubleInput(1647)
rear_tyre_on_ground = BoolSelector(true)
tyre_to_wheel_arch_gap = DoubleSlider(40, range=10..100 step 0.1)
front_overhang_from_axel = DoubleSlider(1250, range=0..2500 step 0.1)
rear_overhang_from_axel = DoubleSlider(802, range=0..2500 step 0.1)
vehicle_height_in_mm = IntegerSlider(1116, range=1000..2000 step 1)

# group: Create Wheels
string = StringInput("/")
string_2 = StringInput("R")
list_create = List.Create(item0=string, item1=string_2)
split = String.Split(str=front_tyre_size, separator0=list_create)
flatten = List.Flatten(list=split)
toNumber = String.ToNumber(str=flatten)
front_tyre_wall_height = CodeBlock(tyreWidth=toNumber, aspectRatio=toNumber) { (tyreWidth[0]/100)*aspectRatio[1]; }
convert_front_rim_diameter_to_mm = CodeBlock(rimSize=toNumber) { rimSize[2]*25.4; }
front_tyre_radius = CodeBlock(tyreWallHeight=front_tyre_wall_height, rimSize=convert_front_rim_diameter_to_mm) { tyreWallHeight+(rimSize/2); }
front_tyre_width_in_mm = CodeBlock(tyreWitdh=toNumber) { tyreWitdh[0]; }
calculate_left_side_of_fl_tyre = CodeBlock(frontTrackWidth=front_track_width_in_mm, tyreWidth=front_tyre_width_in_mm) { (-frontTrackWidth/2)-(tyreWidth/2); }
list_create_2 = List.Create(item0=string, item1=string_2)
split_2 = String.Split(str=rear_tyre_size, separator0=list_create_2)
flatten_2 = List.Flatten(list=split_2)
toNumber_2 = String.ToNumber(str=flatten_2)
rear_tyre_wall_height = CodeBlock(tyreWidth=toNumber_2, aspectRatio=toNumber_2) { (tyreWidth[0]/100)*aspectRatio[1]; }
convert_rear_rim_diameter_to_mm = CodeBlock(rimSize=toNumber_2) { rimSize[2]*25.4; }
rear_tyre_radius = CodeBlock(tyreWallHeight=rear_tyre_wall_height, rimSize=convert_rear_rim_diameter_to_mm) { tyreWallHeight+(rimSize/2); }
rear_tyre_width_in_mm = CodeBlock(tyreWitdh=toNumber_2) { tyreWitdh[0]; }
calculate_left_side_of_rl_tyre = CodeBlock(rearTrackWidth=rear_track_width_in_mm, tyreWidth=rear_tyre_width_in_mm) { (-rearTrackWidth/2)-(tyreWidth/2); }
front_left_tyre_middle = Point.ByCoordinates(y=calculate_left_side_of_fl_tyre, z=front_tyre_radius)
front_rim_radius = CodeBlock(rimDiameter=convert_front_rim_diameter_to_mm) { rimDiameter/2; }
YAxis = Vector.YAxis()
front_wheel_rim_curve = Circle.ByCenterPointRadiusNormal(centerPoint=front_left_tyre_middle, radius=front_rim_radius, normal=YAxis)
extrude = Curve.Extrude(curve=front_wheel_rim_curve, distance=front_tyre_width_in_mm)
boolean = BoolSelector(false)
front_left_wheel = Surface.Thicken(surface=extrude, thickness=front_tyre_wall_height, both_sides=boolean)
rotate_tyre_angle = DoubleInput(90)
XZ = Plane.XZ()
rear_left_tyre_middle = Point.ByCoordinates(x=wheelbase_length_in_mm, y=calculate_left_side_of_rl_tyre, z=front_tyre_radius)
rear_rim_radius = CodeBlock(rimDiameter=convert_rear_rim_diameter_to_mm) { rimDiameter/2; }
rear_wheel_rim_curve = Circle.ByCenterPointRadiusNormal(centerPoint=rear_left_tyre_middle, radius=rear_rim_radius, normal=YAxis)
extrude_2 = Curve.Extrude(curve=rear_wheel_rim_curve, distance=rear_tyre_width_in_mm)
rear_left_wheel = Surface.Thicken(surface=extrude_2, thickness=rear_tyre_wall_height, both_sides=boolean)

# group: Trigonometry Calculation for Tyre on Ground
YAxis_2 = Vector.YAxis()
adjacent = rear_tyre_radius - front_tyre_radius
opposite_adjacent = adjacent / wheelbase_length_in_mm
atan = Math.Atan(ratio=opposite_adjacent)
inverse_value = CodeBlock(inputValue=atan) { inputValue*-1; }
number = DoubleInput(0)
check_for_rear_tyre_on_ground = If(test=rear_tyre_on_ground, true=inverse_value, false=number)

# group: Draw Ground Clearance Line
inverse_value_2 = CodeBlock(inputValue=front_tyre_radius) { inputValue*-1; }
byCoordinates = Point.ByCoordinates(x=inverse_value_2, y=calculate_left_side_of_fl_tyre, z=ground_clearance_in_mm)
wheel_well_width_ratio = DoubleInput(1.66)
mul = front_tyre_width_in_mm * wheel_well_width_ratio
translate = Geometry.Translate(geometry=byCoordinates, yTranslation=mul)
byCoordinates_2 = Point.ByCoordinates(x=front_tyre_radius, y=calculate_left_side_of_fl_tyre, z=ground_clearance_in_mm)
mul_2 = front_tyre_width_in_mm * wheel_well_width_ratio
translate_2 = Geometry.Translate(geometry=byCoordinates_2, yTranslation=mul_2)
sub = wheelbase_length_in_mm - rear_tyre_radius
byCoordinates_3 = Point.ByCoordinates(x=sub, y=calculate_left_side_of_rl_tyre, z=ground_clearance_in_mm)
wheel_well_width_ratio_2 = DoubleInput(1.25)
mul_3 = rear_tyre_width_in_mm * wheel_well_width_ratio_2
translate_3 = Geometry.Translate(geometry=byCoordinates_3, yTranslation=mul_3)
add = wheelbase_length_in_mm + rear_tyre_radius
byCoordinates_4 = Point.ByCoordinates(x=add, y=calculate_left_side_of_rl_tyre, z=ground_clearance_in_mm)
mul_4 = rear_tyre_width_in_mm * wheel_well_width_ratio_2
translate_4 = Geometry.Translate(geometry=byCoordinates_4, yTranslation=mul_4)
list_create_3 = List.Create(item0=byCoordinates, item1=translate, item2=translate_2, item3=byCoordinates_2, item4=byCoordinates_3, item5=translate_3, item6=translate_4, item7=byCoordinates_4)
number_2 = DoubleInput(1)
rear_axel_line = NurbsCurve.ByPoints(points=list_create_3, degree=number_2)
XZ_2 = Plane.XZ()
mirror = Geometry.Mirror(geometry=rear_axel_line, mirrorPlane=XZ_2)
list_create_4 = List.Create(item0=rear_axel_line, item1=mirror)
rotate_if_all_tyres_on_ground = Geometry.Rotate(geometry=list_create_4, origin=front_left_tyre_middle, axis=YAxis_2, degrees=check_for_rear_tyre_on_ground)

# group (continued): Create Wheels
rotate_tyre_angle_offset = CodeBlock(rotateTyreAngle=rotate_tyre_angle, tyreOnGroundRotationAngle=atan) { rotateTyreAngle+tyreOnGroundRotationAngle; }
check_if_rear_tyre_is_touching = If(test=rear_tyre_on_ground, true=rotate_tyre_angle_offset, false=rotate_tyre_angle)  # "Check if Rear Tyre is Touching Ground"
rotate_front_wheel_so_start = Geometry.Rotate(geometry=front_left_wheel, origin=front_left_tyre_middle, axis=YAxis, degrees=check_if_rear_tyre_is_touching)  # "Rotate Front Wheel so Start Vertex is on Ground"
mirror_2 = Geometry.Mirror(geometry=rotate_front_wheel_so_start, mirrorPlane=XZ)
rotate_rear_wheel_so_start = Geometry.Rotate(geometry=rear_left_wheel, origin=rear_left_tyre_middle, axis=YAxis, degrees=check_if_rear_tyre_is_touching)  # "Rotate Rear Wheel so Start Vertex is on Ground"
mirror_3 = Geometry.Mirror(geometry=rotate_rear_wheel_so_start, mirrorPlane=XZ)
all_four_wheels = List.Create(item0=rotate_front_wheel_so_start, item1=mirror_2, item2=rotate_rear_wheel_so_start, item3=mirror_3)
rotate_if_all_tyres_on_ground_2 = Geometry.Rotate(geometry=all_four_wheels, origin=front_left_tyre_middle, axis=YAxis_2, degrees=check_for_rear_tyre_on_ground)

# group: Calculations
wheel_base_length_2 = CodeBlock(wheelBaseLength=wheelbase_length_in_mm) { wheelBaseLength/2; }
car_length_calc = CodeBlock(wheelbaseLength=wheelbase_length_in_mm, frontOverHang=front_overhang_from_axel, rearOverHang=rear_overhang_from_axel)
# ---------- car_length_calc.designscript (3 lines) ----------
wheelbaseLength
+frontOverHang
+rearOverHang;
# ----------------------------------------
calculate_width_at_rear_wheels = rear_track_width_in_mm + rear_tyre_width_in_mm
calculate_width_at_front_wheels = front_track_width_in_mm + front_tyre_width_in_mm
vehicle_back_location_calc = CodeBlock(wheelBaseLength=wheelbase_length_in_mm, rearOverhang=rear_overhang_from_axel)
# ---------- vehicle_back_location_calc.designscript (2 lines) ----------
wheelBaseLength+
rearOverhang;
# ----------------------------------------
inverse_value_to_correctly = CodeBlock(inputValue=front_overhang_from_axel) { inputValue*-1; }  # "Inverse Value to correctly display Vehicle Front X Location"
calculate_front_tyre_diameter = CodeBlock(tyreWallHeight=front_tyre_wall_height, rimSize=convert_front_rim_diameter_to_mm) { tyreWallHeight*2+rimSize; }
calculate_rear_tyre_diameter = CodeBlock(tyreWallHeight=rear_tyre_wall_height, rimSize=convert_rear_rim_diameter_to_mm) { tyreWallHeight*2+rimSize; }
PI = Math.PI()
calculate_front_tyre = calculate_front_tyre_diameter * PI  # "Calculate Front Tyre Circumference"
trye_circumference_precision = IntegerSlider(2, range=0..4 step 1)
round_down_front_tyre = Math.Round(number=calculate_front_tyre, digits=trye_circumference_precision)  # "Round Down Front Tyre Circumference"
calculate_rear_tyre = calculate_rear_tyre_diameter * PI  # "Calculate Rear Tyre Circumference"
round_down_rear_tyre = Math.Round(number=calculate_rear_tyre, digits=trye_circumference_precision)  # "Round Down Rear Tyre Circumference"

# group: Wheelbase Length Graphic
wheelbase_arrow_point_1 = Point.ByCoordinates(z=front_tyre_radius)
x_y_offsets = CodeBlock { 100; -100; }
wheelbase_arrow_point_2 = Point.ByCoordinates(x=x_y_offsets.out0, y=x_y_offsets.out0, z=front_tyre_radius)
wheelbase_arrow_point_3 = Point.ByCoordinates(x=wheel_base_length_2, y=x_y_offsets.out0, z=front_tyre_radius)
wheelbase_arrow_point_4 = Point.ByCoordinates(x=wheel_base_length_2, y=x_y_offsets.out1, z=front_tyre_radius)
wheelbase_arrow_point_5 = Point.ByCoordinates(x=x_y_offsets.out0, y=x_y_offsets.out1, z=front_tyre_radius)
list_create_5 = List.Create(item0=wheelbase_arrow_point_1, item1=wheelbase_arrow_point_2, item2=wheelbase_arrow_point_3, item3=wheelbase_arrow_point_4, item4=wheelbase_arrow_point_5)
byPoints = Polygon.ByPoints(points=list_create_5)
byPatch = Surface.ByPatch(closedCurve=byPoints)
translate_5 = Geometry.Translate(geometry=byPatch, xTranslation=wheel_base_length_2)
wheelbase_length_indicator = List.Create(item0=byPatch, item1=translate_5)
rotate_if_all_tyres_on_ground_3 = Geometry.Rotate(geometry=wheelbase_length_indicator, origin=front_left_tyre_middle, axis=YAxis_2, degrees=check_for_rear_tyre_on_ground)

# group: Draw Axel Lines
code_block = CodeBlock(tyreWidth=front_tyre_width_in_mm) { tyreWidth/2; }
translate_6 = Geometry.Translate(geometry=front_left_tyre_middle, yTranslation=code_block)
mirror_4 = Geometry.Mirror(geometry=translate_6, mirrorPlane=XZ)
list_create_6 = List.Create(item0=translate_6, item1=mirror_4)
number_3 = DoubleInput(1)
front_axel_line = NurbsCurve.ByPoints(points=list_create_6, degree=number_3)
code_block_2 = CodeBlock(tyreWidth=rear_tyre_width_in_mm) { tyreWidth/2; }
translate_7 = Geometry.Translate(geometry=rear_left_tyre_middle, yTranslation=code_block_2)
mirror_5 = Geometry.Mirror(geometry=translate_7, mirrorPlane=XZ)
list_create_7 = List.Create(item0=translate_7, item1=mirror_5)
rear_axel_line_2 = NurbsCurve.ByPoints(points=list_create_7, degree=number_3)
combine_axel_lines = List.Create(item0=front_axel_line, item1=rear_axel_line_2)
rotate_if_all_tyres_on_ground_4 = Geometry.Rotate(geometry=combine_axel_lines, origin=front_left_tyre_middle, axis=YAxis_2, degrees=check_for_rear_tyre_on_ground)

# group: Draw Wheel Arch Gap
add_2 = front_tyre_radius + tyre_to_wheel_arch_gap
code_block_3 = CodeBlock { -180; 0; }
YAxis_3 = Vector.YAxis()
byCenterPointRadiusAngle = Arc.ByCenterPointRadiusAngle(center=front_left_tyre_middle, radius=add_2, startAngle=code_block_3.out0, endAngle=code_block_3.out1, normal=YAxis_3)
startPoint = Curve.StartPoint(curve=byCenterPointRadiusAngle)
wheel_arch_tangent_ratio = IntegerSlider(6, range=3..8 step 1)
code_block_4 = CodeBlock(tyreRadius=front_tyre_radius, groundClearance=ground_clearance_in_mm, wheelArchTangentRatio=wheel_arch_tangent_ratio) { (tyreRadius-groundClearance)/wheelArchTangentRatio*-1; }
translate_8 = Geometry.Translate(geometry=startPoint, zTranslation=code_block_4)
list_create_8 = List.Create(item0=startPoint, item1=translate_8, item2=byCoordinates)
degree = DoubleInput(2)
byPoints_2 = NurbsCurve.ByPoints(points=list_create_8, degree=degree)
YZ = Plane.YZ()
mirror_6 = Geometry.Mirror(geometry=byPoints_2, mirrorPlane=YZ)
add_3 = rear_tyre_radius + tyre_to_wheel_arch_gap
byCenterPointRadiusAngle_2 = Arc.ByCenterPointRadiusAngle(center=rear_left_tyre_middle, radius=add_3, startAngle=code_block_3.out0, endAngle=code_block_3.out1, normal=YAxis_3)
startPoint_2 = Curve.StartPoint(curve=byCenterPointRadiusAngle_2)
code_block_5 = CodeBlock(tyreRadius=front_tyre_radius, groundClearance=ground_clearance_in_mm, wheelArchTangentRatio=wheel_arch_tangent_ratio) { (tyreRadius-groundClearance)/wheelArchTangentRatio*-1; }
translate_9 = Geometry.Translate(geometry=startPoint_2, zTranslation=code_block_5)
list_create_9 = List.Create(item0=startPoint_2, item1=translate_9, item2=byCoordinates_3)
byPoints_3 = NurbsCurve.ByPoints(points=list_create_9, degree=degree)
XAxis = Vector.XAxis()
byOriginNormal = Plane.ByOriginNormal(origin=rear_left_tyre_middle, normal=XAxis)
mirror_7 = Geometry.Mirror(geometry=byPoints_3, mirrorPlane=byOriginNormal)
list_create_10 = List.Create(item0=byPoints_2, item1=byCenterPointRadiusAngle, item2=mirror_6, item3=byPoints_3, item4=byCenterPointRadiusAngle_2, item5=mirror_7)
XZ_3 = Plane.XZ()
mirror_8 = Geometry.Mirror(geometry=list_create_10, mirrorPlane=XZ_3)
list_create_11 = List.Create(item0=list_create_10, item1=mirror_8)
rotate_if_all_tyres_on_ground_5 = Geometry.Rotate(geometry=list_create_11, origin=front_left_tyre_middle, axis=YAxis_2, degrees=check_for_rear_tyre_on_ground)

# group: Front and Rear Overhang Markers
YZ_2 = Plane.YZ()
uk_number_plate_size = CodeBlock { 520; 111; }
uk_number_plate = Rectangle.ByWidthLength(plane=YZ_2, width=uk_number_plate_size.out0, length=uk_number_plate_size.out1)
japanese_import_plate_size = CodeBlock { 330; 165; }
uk_legal_japanese_import_plate = Rectangle.ByWidthLength(plane=YZ_2, width=japanese_import_plate_size.out0, length=japanese_import_plate_size.out1)
us_plate_size = CodeBlock { 304.8; 152.4; }
us_plate = Rectangle.ByWidthLength(plane=YZ_2, width=us_plate_size.out0, length=us_plate_size.out1)
number_plate_collection = List.Create(item0=uk_number_plate, item1=uk_legal_japanese_import_plate, item2=us_plate)
inverse_value_3 = CodeBlock(inputValue=front_overhang_from_axel) { inputValue*-1; }
translate_10 = Geometry.Translate(geometry=number_plate_collection, xTranslation=inverse_value_3, zTranslation=front_tyre_radius)
code_block_6 = CodeBlock(wheelbaseLength=wheelbase_length_in_mm, rearOverhang=rear_overhang_from_axel) { wheelbaseLength+rearOverhang; }
translate_11 = Geometry.Translate(geometry=number_plate_collection, xTranslation=code_block_6, zTranslation=rear_tyre_radius)
list_create_12 = List.Create(item0=translate_10, item1=translate_11)

# group: Draw Golden Spiral
goldenRatio = Math.GoldenRatio()
phi_length_1 = car_length_calc / goldenRatio
sub_2 = phi_length_1 - front_overhang_from_axel
byCoordinates_5 = Point.ByCoordinates(x=sub_2)
angles = CodeBlock { 0; 90; 180; -180; -90; }
YAxis_4 = Vector.YAxis()
arc_1 = Arc.ByCenterPointRadiusAngle(center=byCoordinates_5, radius=phi_length_1, startAngle=angles.out3, endAngle=angles.out4, normal=YAxis_4)
phi_length_2 = phi_length_1 / goldenRatio
sub_3 = phi_length_1 - phi_length_2
translate_12 = Geometry.Translate(geometry=byCoordinates_5, zTranslation=sub_3)
arc_2 = Arc.ByCenterPointRadiusAngle(center=translate_12, radius=phi_length_2, startAngle=angles.out4, endAngle=angles.out0, normal=YAxis_4)
phi_length_3 = phi_length_2 / goldenRatio
sub_4 = phi_length_2 - phi_length_3
translate_13 = Geometry.Translate(geometry=translate_12, xTranslation=sub_4)
arc_3 = Arc.ByCenterPointRadiusAngle(center=translate_13, radius=phi_length_3, startAngle=angles.out0, endAngle=angles.out1, normal=YAxis_4)
phi_length_4 = phi_length_3 / goldenRatio
sub_5 = phi_length_3 - phi_length_4
reverse_value = CodeBlock(phiLength=sub_5) { phiLength*-1; }
translate_14 = Geometry.Translate(geometry=translate_13, zTranslation=reverse_value)
arc_4 = Arc.ByCenterPointRadiusAngle(center=translate_14, radius=phi_length_4, startAngle=angles.out1, endAngle=angles.out2, normal=YAxis_4)
phi_length_5 = phi_length_4 / goldenRatio
sub_6 = phi_length_4 - phi_length_5
reverse_value_2 = CodeBlock(phiLength=sub_6) { phiLength*-1; }
translate_15 = Geometry.Translate(geometry=translate_14, xTranslation=reverse_value_2)
arc_5 = Arc.ByCenterPointRadiusAngle(center=translate_15, radius=phi_length_5, startAngle=angles.out3, endAngle=angles.out4, normal=YAxis_4)
phi_length_6 = phi_length_5 / goldenRatio
sub_7 = phi_length_5 - phi_length_6
translate_16 = Geometry.Translate(geometry=translate_15, zTranslation=sub_7)
arc_6 = Arc.ByCenterPointRadiusAngle(center=translate_16, radius=phi_length_6, startAngle=angles.out4, endAngle=angles.out0, normal=YAxis_4)
phi_length_7 = phi_length_6 / goldenRatio
sub_8 = phi_length_6 - phi_length_7
translate_17 = Geometry.Translate(geometry=translate_16, xTranslation=sub_8)
arc_7 = Arc.ByCenterPointRadiusAngle(center=translate_17, radius=phi_length_7, startAngle=angles.out0, endAngle=angles.out1, normal=YAxis_4)
phi_length_8 = phi_length_7 / goldenRatio
sub_9 = phi_length_7 - phi_length_8
inverse_value_4 = CodeBlock(phiLength=sub_9) { phiLength*-1; }
translate_18 = Geometry.Translate(geometry=translate_17, zTranslation=inverse_value_4)
arc_8 = Arc.ByCenterPointRadiusAngle(center=translate_18, radius=phi_length_8, startAngle=angles.out1, endAngle=angles.out2, normal=YAxis_4)
phi_length_9 = phi_length_8 / goldenRatio
sub_10 = phi_length_8 - phi_length_9
inverse_value_5 = CodeBlock(phiLength=sub_10) { phiLength*-1; }
translate_19 = Geometry.Translate(geometry=translate_18, xTranslation=inverse_value_5)
arc_9 = Arc.ByCenterPointRadiusAngle(center=translate_19, radius=phi_length_9, startAngle=angles.out3, endAngle=angles.out4, normal=YAxis_4)
golden_spiral_segments = List.Create(item0=arc_1, item1=arc_2, item2=arc_3, item3=arc_4, item4=arc_5, item5=arc_6, item6=arc_7, item7=arc_8, item8=arc_9)

# group: Draw rectangle for vehicle height
XY = Plane.XY()
half_front_track_width = CodeBlock(frontTrackWidth=front_track_width_in_mm) { frontTrackWidth/2; }
byWidthLength = Rectangle.ByWidthLength(plane=XY, width=wheel_base_length_2, length=half_front_track_width)
translate_20 = Geometry.Translate(geometry=byWidthLength, xTranslation=wheel_base_length_2, zTranslation=vehicle_height_in_mm)

# group: 1/3 Divsion Markers
inverse_number = CodeBlock(inputValue=front_overhang_from_axel) { inputValue*-1; }
code_block_7 = CodeBlock(frontTrackWidth=front_track_width_in_mm) { (frontTrackWidth/4)*-1; }
thirds_arrow_point_1 = Point.ByCoordinates(x=inverse_number, y=code_block_7, z=ground_clearance_in_mm)
car_length_3 = CodeBlock(carLength=car_length_calc) { carLength/3; }
thirds_arrow_point_2 = Geometry.Translate(geometry=thirds_arrow_point_1, xTranslation=car_length_3, yTranslation=x_y_offsets.out0)
thirds_arrow_point_3 = Geometry.Translate(geometry=thirds_arrow_point_1, xTranslation=car_length_3, yTranslation=x_y_offsets.out1)
list_create_13 = List.Create(item0=thirds_arrow_point_1, item1=thirds_arrow_point_2, item2=thirds_arrow_point_3)
byPoints_4 = Polygon.ByPoints(points=list_create_13)
byPatch_2 = Surface.ByPatch(closedCurve=byPoints_4)
translate_21 = Geometry.Translate(geometry=byPatch_2, xTranslation=car_length_3)
translate_22 = Geometry.Translate(geometry=translate_21, xTranslation=car_length_3)
thirds_indicator_arrows = List.Create(item0=byPatch_2, item1=translate_21, item2=translate_22)

# group: 1/4 Divsion Markers
inverse_number_2 = CodeBlock(inputValue=front_overhang_from_axel) { inputValue*-1; }
code_block_8 = CodeBlock(frontTrackWidth=front_track_width_in_mm) { (frontTrackWidth/4); }
quarter_arrow_point_1 = Point.ByCoordinates(x=inverse_number_2, y=code_block_8, z=ground_clearance_in_mm)
car_length_4 = CodeBlock(carLength=car_length_calc) { carLength/4; }
quarter_arrow_point_2 = Geometry.Translate(geometry=quarter_arrow_point_1, xTranslation=car_length_4, yTranslation=x_y_offsets.out0)
quarter_arrow_point_3 = Geometry.Translate(geometry=quarter_arrow_point_1, xTranslation=car_length_4, yTranslation=x_y_offsets.out1)
list_create_14 = List.Create(item0=quarter_arrow_point_1, item1=quarter_arrow_point_2, item2=quarter_arrow_point_3)
byPoints_5 = Polygon.ByPoints(points=list_create_14)
byPatch_3 = Surface.ByPatch(closedCurve=byPoints_5)
translate_23 = Geometry.Translate(geometry=byPatch_3, xTranslation=car_length_4)
translate_24 = Geometry.Translate(geometry=translate_23, xTranslation=car_length_4)
translate_25 = Geometry.Translate(geometry=translate_24, xTranslation=car_length_4)
quarter_indicator_arrows = List.Create(item0=byPatch_3, item1=translate_23, item2=translate_24, item3=translate_25)

# group: Additional Geometry for STL Export
thickness = DoubleInput(2)
# note: To get proper orientation and scale in Blender use these settings during import:
# Scale set to 0.001
# Forward set to "-Z"
# Up set to "Y Up"
# Export notes: When making alterations to the wheelbase script Dynamo holds old geometry in memory which gets exported with the STL. To export a clean STL quit and restart the application, reload the script and then export.
golden_spiral = TSpline.TSplineSurface.BuildPipes(curves=golden_spiral_segments, defaultRadius=thickness)
roof_height = Curve.Extrude(curve=translate_20, distance=thickness)
wheel_arch_gap = TSpline.TSplineSurface.BuildPipes(curves=rotate_if_all_tyres_on_ground_5, defaultRadius=thickness)
number_plates = Surface.ByPatch(closedCurve=list_create_12)
ground_clearance_line = TSpline.TSplineSurface.BuildPipes(curves=rotate_if_all_tyres_on_ground, defaultRadius=thickness)

# group: Construct Axels
translate_26 = Geometry.Translate(geometry=translate_6, yTranslation=code_block)
number_4 = DoubleInput(20)
byPointsRadius = Cone.ByPointsRadius(startPoint=translate_26, endPoint=translate_6, startRadius=number_4)
reverse_value_3 = CodeBlock(inputValue=code_block) { inputValue*-1; }
translate_27 = Geometry.Translate(geometry=wheelbase_arrow_point_1, yTranslation=reverse_value_3)
byPointsRadius_2 = Cylinder.ByPointsRadius(startPoint=translate_26, endPoint=translate_27, radius=number_4)
byPointsRadius_3 = Cone.ByPointsRadius(startPoint=translate_27, endPoint=wheelbase_arrow_point_1, startRadius=number_4)
translate_28 = Geometry.Translate(geometry=translate_7, yTranslation=code_block)
byPointsRadius_4 = Cone.ByPointsRadius(startPoint=translate_28, endPoint=translate_7, startRadius=number_4)
translate_29 = Geometry.Translate(geometry=wheelbase_arrow_point_1, xTranslation=wheelbase_length_in_mm)
reverse_value_4 = CodeBlock(inputValue=code_block_2) { inputValue*-1; }
translate_30 = Geometry.Translate(geometry=translate_29, yTranslation=reverse_value_4)
byPointsRadius_5 = Cylinder.ByPointsRadius(startPoint=translate_28, endPoint=translate_30, radius=number_4)
byPointsRadius_6 = Cone.ByPointsRadius(startPoint=translate_30, endPoint=translate_29, startRadius=number_4)
axel_rods_left = List.Create(item0=byPointsRadius, item1=byPointsRadius_2, item2=byPointsRadius_3, item3=byPointsRadius_4, item4=byPointsRadius_5, item5=byPointsRadius_6)
XZ_4 = Plane.XZ()
axel_rods_right = Geometry.Mirror(geometry=axel_rods_left, mirrorPlane=XZ_4)
combine_axel_rods = List.Create(item0=axel_rods_left, item1=axel_rods_right)
axel_rods = List.Flatten(list=combine_axel_rods)
rotate_if_all_tyres_on_ground_6 = Geometry.Rotate(geometry=axel_rods, origin=front_left_tyre_middle, axis=YAxis_2, degrees=check_for_rear_tyre_on_ground)

# group: Output Data to Alias
send_ground_clearance_to_alias = BakeNode(rotate_if_all_tyres_on_ground)
send_4_wheels_to_alias = BakeNode(rotate_if_all_tyres_on_ground_2)
send_wheelbase_length_indicator = BakeNode(rotate_if_all_tyres_on_ground_3)  # "Send wheelbase length indicator to Alias"
send_axel_lines_to_alias = BakeNode(rotate_if_all_tyres_on_ground_4)
send_wheel_arch_gap_to_alias = BakeNode(rotate_if_all_tyres_on_ground_5)
send_front_and_rear_overhang = BakeNode(list_create_12)  # "Send Front and Rear Overhang Markers to Alias"
send_golden_spiral_to_alias = BakeNode(golden_spiral_segments)
send_vehicle_height_marker_to = BakeNode(translate_20)  # "Send Vehicle Height Marker to Alias"
send_1_3_division_markers_to = BakeNode(thirds_indicator_arrows)  # "Send 1/3 Division Markers to Alias"
send_1_4_division_markers_to = BakeNode(quarter_indicator_arrows)  # "Send 1/4 Division Markers to Alias"
send_axel_rods_to_alias = BakeNode(rotate_if_all_tyres_on_ground_6)

# group: Useful Stats
rear_wheel_to_wheel_width = Watch(calculate_width_at_rear_wheels)
front_wheel_to_wheel_width = Watch(calculate_width_at_front_wheels)
half_wheelbase_length = Watch(wheel_base_length_2)
total_car_length = Watch(car_length_calc)
x_location_of_vehicle_back = Watch(vehicle_back_location_calc)
x_location_of_vehicle_front = Watch(inverse_value_to_correctly)
front_tyre_width = Watch(front_tyre_width_in_mm)
rear_tyre_width = Watch(rear_tyre_width_in_mm)
front_tyre_diameter = Watch(calculate_front_tyre_diameter)
rear_tyre_diameter = Watch(calculate_rear_tyre_diameter)
rear_tyre_wall_height_2 = Watch(rear_tyre_wall_height)
front_tyre_wall_height_2 = Watch(front_tyre_wall_height)
rear_rim_diameter = Watch(convert_rear_rim_diameter_to_mm)
front_rim_diameter = Watch(convert_front_rim_diameter_to_mm)
front_tyre_circumference = Watch(round_down_front_tyre)
rear_tyre_circumference = Watch(round_down_rear_tyre)
rotation_angle_for_grounding = Watch(inverse_value)  # "Rotation Angle for Grounding Rear Tyre"
